vi "index.gviweb"   [G Web Development Software 22.3.0]
panel controls:
  "Start Button": bool
  "Pause Button": bool
  "Reset Button": bool
panel indicators:
  "Timer": f64
  "Running": bool
types:
  "Timer Status.gtype" = cluster{"Elapsed": f64, "Running": bool}
uses:
  NI::Skyline::Configuration::Open Configuration.gvi
  NI::Skyline::MessageHTTP::Open.gvi
  NI::Skyline::MessageHTTP::Subscribe.gvi
  NI::Skyline::MessageHTTP::Publish.gvi
  NI::Skyline::MessageHTTP::Read.gvi
diagram:
  call "Open Configuration.gvi"(server url="http://localhost:80", username="admin", password="12345") -> (configuration=w1, error out=w2)
  call "Open.gvi"(error in=w2, configuration=w1) -> (message session=w3, error out=w4)
  # Only subscribing to one message here but using a for loop for convenient expansion to include more messages.
  s1 = w3  # shift register
  s2 = w4  # shift register
  for {
    w5 = each element of ["Timer Status"]
    call "Subscribe.gvi"(message session in=s1, topic=w5, error in=s2) -> (message session out=w6, error out=w7)
    next s1 = w6
    next s2 = w7
  }
  while {
    event {
      on "Start Button" Value changed {
        # Messages cannot have empty data but data isn't needed for this message. Can just use a space to avoid the empty message error.
        call "Publish.gvi"(message session in=s1, topic="Start Timer", message=" ")
      }
      on "Pause Button" Value changed {
        # Messages cannot have empty data but data isn't needed for this message. Can just use a space to avoid the empty message error.
        call "Publish.gvi"(message session in=s1, topic="Pause Timer", message=" ")
      }
      on "Reset Button" Value changed {
        # Messages cannot have empty data but data isn't needed for this message. Can just use a space to avoid the empty message error.
        call "Publish.gvi"(message session in=s1, topic="Reset Timer", message=" ")
      }
    }
    stop if FALSE
  }
  # The web app doesn't ever need to close, the user can just close the browser/tab.
  while {
    call "Read.gvi"(message session in=s1, error in=s2) -> (dequeue status=w8, topic=w9, message=w10)
    case (w8) {
      frame False, Default { }
      frame True {
        case (w9) {
          frame Default { }
          frame "Update Delay" {
            Scan Value(format string="%f", string=w10)
          }
          frame "Update Cycles" {
            Scan Value(default (0 dbl)=0, format string="%d", string=w10)
          }
          frame "Timer Status" {
            # Timer Status.gtype docked to node
            Unflatten From Json(JSON string=w10, type and defaults="Timer Status.gtype" {all zero or empty}) -> (value=w11)
            Property Node(instance in=w11) -> ("Elapsed"=w12, "Running"=w13)
            $Timer <- w12
            $Running <- w13
          }
        }
      }
    }
    stop if FALSE
  }
